# Grasshopper definition Effects-test.gh (Grasshopper 0.9.76)
# plug-ins: Effects

number_slider = Slider(0.5, range=0..1)
number_slider_2 = Slider(3, range=0..3)
number_slider_3 = Slider(1, range=0..1)
panel = Panel("""0
0.5
1""")
expression = Expression(x=number_slider_3, y=number_slider_2, z=number_slider, Expression="x*z-y")
ma = MassAddition(Input=[number_slider_3, number_slider_2, number_slider])  # -> Result, PartialResults
effects = Effects(
    Variables=[number_slider_3, number_slider_2, number_slider],
    Objectives=[ma.Result, expression],
    Levels=Slider(3, range=0..10),
    LevelSettings=panel,
    NumberOfObjectives=Slider(2, range=0..10))  # -> AverageEffects, RawEffects, DesignMapObjectives
panel_2 = Panel(effects.AverageEffects)
