# Grasshopper definition MOO-test.gh (Grasshopper 0.9.76)
# plug-ins: MOO

number_slider = Slider(9.655, range=0..10)
number_slider_2 = Slider(4.716, range=0..10)
expression = Expression(x=number_slider, Expression="10-x^(1/2)")
addition = Addition(A=number_slider, B=number_slider_2)
moo = MOO(
    Variables=[number_slider, number_slider_2],
    Objectives=[addition, expression],
    PopulationSize=Slider(20, range=0..100),
    MaxEvaluations=Slider(100, range=0..100),
    Filename="MOO-test-1.csv",
    Directory="C:\Code\gh-design-space-exploration\Sampler\bin\moo_")  # -> ParetoFront, AllSolutions
