# Grasshopper definition MOO-test_unplugged.gh (Grasshopper 0.9.76)

number_slider = Slider(6.856, range=0..10)
panel = Panel("C:\Code\gh-design-space-exploration\Sampler\bin\")
number_slider_2 = Slider(20, range=0..100)
panel_2 = Panel("MOO-test-1.csv")
number_slider_3 = Slider(100, range=0..100)
expression = Expression(x=number_slider, Expression="10-x^(1/2)")
addition = Addition(A=number_slider, B=Slider(0.931, range=0..10))
