# Grasshopper definition capture-test.gh (Grasshopper 0.9.76)
# plug-ins: Capture, Sampler

panel = Panel("D:\CTMueller\Digital Structures\Code\gh-design-space-exploration\Sampler\bin\")
number_slider = Slider(8.133, range=1..10)
number_slider_2 = Slider(2.882, range=1..10)
number_slider_3 = Slider(6.013, range=1..10)
sampler = Sampler(
    Variables=[number_slider_2, number_slider, number_slider_3],
    Samples="100",
    Type=0,
    Seed="0",
    Prefix="test-01",
    Path=panel)
panel_2 = Panel(sampler)
panel_3 = Panel("D:\CTMueller\Digital Structures\Code\gh-design-space-exploration\Capture\bin\")
ma = MassAddition(Input=[number_slider_2, number_slider, number_slider_3])  # -> Result, PartialResults
capture = Capture(
    Variables=[number_slider_2, number_slider, number_slider_3],
    Objectives=ma.Result,
    Mode=1,
    Properties=ma.Result,
    DesignMap=sampler,
    CsvFilename="data",
    CsvDirectory=panel_3,
    ScreenshotFilename="screenshot",
    ScreenshotDirectory=panel_3)  # -> DesignMapObjectives, CapturedProperties
panel_4 = Panel(capture.DesignMapObjectives)
panel_5 = Panel(capture.CapturedProperties)
