# Grasshopper definition diversity-test.gh (Grasshopper 0.9.76)
# plug-ins: Sampler, Diversity

sampler = Sampler(Variables=[Slider(4, range=1..10), Slider(4, range=1..10)], Samples="10", Type=0, Seed="3", Directory="None")  # -> DesignMap, Data
item = ListItem(List=sampler.DesignMap, Index=Slider(1, range=0..1), Wrap=True)
item_2 = ListItem(List=sampler.DesignMap, Index=0, Wrap=True)
panel = Panel(sampler.DesignMap)
addition = Addition(A=item_2, B=item)
panel_2 = Panel(addition)
item_3 = ListItem(List=panel, Index=1, Wrap=True)
panel_3 = Panel(item_3)
button = Button()
button_2 = Button()
diversity = Diversity(
    DesignMap=panel,
    Mode=0,
    ObjectiveScores=addition,
    ObjectiveTargets=Slider(11, range=0..100),
    ObjectiveThreshold=Slider(0.2, range=0..1),
    CullTo=Slider(10, range=0..10),
    Run=Toggle(True))  # -> DivCulled, DivFull, Test, Culled, All
panel_4 = Panel(diversity.DivCulled)
panel_5 = Panel(diversity.DivFull)
panel_6 = Panel(diversity.All)
panel_7 = Panel(diversity.Culled)
