# Grasshopper definition reader-test.gh (Grasshopper 0.9.76)
# plug-ins: Reader

number_of_variables = Slider(2, range=0..5)
reader = Reader(Filepath="C:\Temp\reader-test-data.csv", Separator=",")
split = SplitList(List=reader, Index=number_of_variables)  # -> ListA, ListB
panel = Panel(split.ListA)
panel_2 = Panel(split.ListB)
