# Grasshopper definition sift-test.gh (Grasshopper 0.9.76)
# plug-ins: Sift, Sampler

number_slider = Slider(6.184, range=1..10)
number_slider_2 = Slider(5.046, range=1..10)
number_slider_3 = Slider(3.2, range=1..10)
sampler = Sampler(
    Variables=[number_slider, number_slider_2, number_slider_3],
    Samples="100",
    Type=0,
    Seed="0",
    Filename="test-01",
    Directory="C:\Code\gh-design-space-exploration\Sampler\bin")
panel = Panel(sampler)
sift = Sift(Variables=[number_slider, number_slider_2, number_slider_3], DesignMap=panel, Index=Slider(2, range=0..100))
panel_2 = Panel(sift)
box = CenterBox(Base=PlaneXY(0, 0, 0), X=number_slider, Y=number_slider_2, Z=number_slider_3)
