# Grasshopper definition stepper-test.gh (Grasshopper 0.9.76)

number_slider = Slider(5, range=0..10)
number_slider_2 = Slider(5, range=0..10)
number_slider_3 = Slider(0, range=0..100)
number_slider_4 = Slider(5, range=0..10)
ma = MassAddition(Input=[number_slider_4, number_slider_2, number_slider])  # -> Result, PartialResults
multiplication = Multiplication(A=ma.Result, B=2)
num = Number([number_slider_4, number_slider_2, number_slider])
