# Grasshopper definition stepper-test_complicated_function.gh (Grasshopper 0.9.76)
# plug-ins: Stepper

number_slider = Slider(5, range=0..10)
number_slider_2 = Slider(5, range=0..10)
number_slider_3 = Slider(5, range=0..10)
number_slider_4 = Slider(5.05, range=0..10)
number_slider_5 = Slider(5.05, range=0..10)
number_slider_6 = Slider(5.05, range=0..10)
toggle = BooleanToggle(False)
button = Button()
expression = Expression(
    x=number_slider_6,
    y=number_slider_5,
    z=number_slider_4,
    u=number_slider_3,
    v=number_slider_2,
    w=number_slider,
    Expression="(x+y)*2*z*u/v+w")
ma = MassAddition(Input=[number_slider_6, number_slider_5, number_slider_4])  # -> Result, PartialResults
multiplication = Multiplication(A=ma.Result, B=2)
stepper = Stepper(
    Variables=[number_slider_6, number_slider_5, number_slider_4, number_slider_3, number_slider_2, number_slider, Slider(5, range=0..10), Slider(5, range=0..10), Slider(5, range=0..10)],
    Objectives=ma.Result,
    WhichObjective=0,
    StepSize=0.05,
    Direction=1,
    Step=False)  # -> Gradient, B1, B2, B3
num = Number()
