# Grasshopper definition tilde-test.gh (Grasshopper 0.9.76)
# plug-ins: Reader, TILDA

data_path = Panel("C:\Users\ncbrown\Dropbox (MIT)\Tools Testing\Tilda\PI_struct_Nate_100samples.csv")
separator = Panel(",")
reader = Reader(Filepath=data_path, Separator=separator)
panel = Panel(reader)
number = Number([Slider(6.486, range=0..10), Slider(2.439, range=0..10), Slider(7.216, range=0..10), Slider(5.56, range=0..10), Slider(7.078, range=0..10), Slider(1.091, range=0..10)])
tilde = Tilde(DesignMapObjectives=panel, NumberOfVariables=Slider(6, range=0..10), TrainingValidationRatio=0.5, Variables=number)  # -> Output, ModelType, NuisanceParameter, AllModels, AllModelParameters, AllModelErrors
panel_2 = Panel(tilde.Output)
