# Grasshopper definition writer-test.gh (Grasshopper 0.9.76)
# plug-ins: Writer, Sampler

sampler = Sampler(
    Variables=[Slider(4, range=1..10), Slider(4, range=1..10), Slider(4, range=1..10)],
    Samples="100",
    Type=0,
    Seed="0",
    Filename="testncb-01",
    Directory="C:\Code\gh-design-space-exploration\Sampler\bin\")
panel = Panel(sampler)
writer = Writer(Data=panel, Filepath="C:\Code\gh-design-space-exploration\Sampler\bin\writertest")
